# Grasshopper definition test._py.gh (Grasshopper 1.0.7)

python = GhPythonScript(x=Slider(5.6, range=0..10), y=Slider(2.8, range=0..10), z=Slider(3.6, range=0..10))  # -> out, a
# ---------- python: Python ----------
__author__ = "Damon"
__version__ = "2018.11.07"

import rhinoscriptsyntax as rs
import sys

#import Rhino.Geometry as rh

import theliving_geo as tl

tl.who_am_i()

a = tl.point(x,y,z)

print(a)
# ---------- end python ----------
panel = Panel(python.a)
