# Dynamo graph test_dyn.dyn (Dynamo 2.0.2.6660)

python_script = Python()  # unwired: IN[0]
# ---------- python_script.python (12 lines) ----------
# Enable Python support and load DesignScript library
import clr, sys
clr.AddReference('ProtoGeometry')
from Autodesk.DesignScript.Geometry import *

# The inputs to this node will be stored as a list in the IN variables.
dataEnteringNode = IN

# Place your code below this line

# Assign your output to the OUT variable.
OUT = '00000000000000000',sys.version
# ----------------------------------------
watch = Watch(python_script)
file_path = Filename(".\test_dyn.py")
readText = FileSystem.ReadText(file=file_path)
watch_2 = Watch(readText)
number_slider = DoubleSlider(35.3, range=0..100 step 0.1)
number_slider_2 = DoubleSlider(35.3, range=0..100 step 0.1)
number_slider_3 = DoubleSlider(35.3, range=0..100 step 0.1)
python_script_from_string = PythonStringNode(script=readText, IN[0]=number_slider, IN[1]=number_slider_2, IN[2]=number_slider_3)
watch_3 = Watch(python_script_from_string)
